# Grasshopper definition Test for ArchiVision.gh (Grasshopper 1.0.7)
# plug-ins: ArchiVision

nickname = CurveDisplayAttribute(Colour=RGB(255, 0, 0), Thickness=Slider(8, range=0..10), LineType=-1, TopMost=True)
mbox = MeshBox(Base={Plane=PlaneXY(0, 0, 0), X=Domain(-10, 10), Y=Domain(-10, 10), Z=Domain(-10, 10)}, XCount=10, YCount=10, ZCount=10)
crv = Curve(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)
nickname_2 = CurveDisplayAttribute(Colour=RGB(168, 255, 5), Thickness=Slider(4, range=0..10), LineType=-1, TopMost=True)
nickname_3 = CurveDisplayAttribute(Colour=RGB(214, 15, 15), Thickness=Slider(9, range=0..10), LineType=4, Absolute=False)
msphere = MeshSphere(Base=PlaneXY(7.571279692, 12.30445437, 5.64249058), Radius=10, UCount=10, VCount=20)
crv_ri = CurveRenderItem(Curve=crv, CurveRenderAttribute=nickname, StartArrow=False, EndArrow=False, ArrowMult=10)
s_ri = ShaderRenderItem(
    Mesh=mbox,
    Material={diffuse=RGB(255, 255, 255), emission=RGB(76, 76, 76), shine=0.5, specular=RGB(255, 255, 255), transparency=0},
    AngleLimit=0.5235987756,
    SharpEdgeAttribute=nickname_2,
    OutLineAttribute=nickname_3)
nickname_4 = CurveDisplayAttribute(Colour=RGB(214, 15, 15), Thickness=Slider(9, range=0..10), LineType=4, Absolute=False)
s_ri_2 = ShaderRenderItem(
    Mesh=msphere,
    Material={diffuse=RGB(255, 255, 255), emission=RGB(76, 76, 76), shine=0.5, specular=RGB(255, 255, 255), transparency=0},
    AngleLimit=0.5235987756)
c_script = CSharpScript(x=s_ri)  # -> out, A
# ---------- c_script: C# ----------
   A = this.Component.Params.Input[0].Sources[0];
# ---------- end c_script ----------
python = GhPythonScript(x=c_script.A)  # -> out, a
# ---------- python: Python ----------
a = x.Hidden
# ---------- end python ----------
ms_ri = MergedShaderRenderItem(RenderItem=[s_ri_2, s_ri], IntersectLineAttribute=nickname_4)
